# Dynamo custom node Export Views to NavisWorks.dyf (Dynamo 1.3.2.2480)
# category: Data-Shapes.Export
# exports 3d views to NavisWorks

views = Input()
Directorypath = Input()
prefix = Input()
python_script = Python(IN[0]=views, IN[1]=Directorypath, IN[2]=prefix)
# ---------- python_script.python (22 lines) ----------
import clr
clr.AddReference('RevitAPI')
from Autodesk.Revit.DB import*

clr.AddReference('RevitServices')
from RevitServices.Persistence import DocumentManager

doc = DocumentManager.Instance.CurrentDBDocument

if isinstance(IN[0],list):
	views = UnwrapElement(IN[0])
else: 
	views = [UnwrapElement(IN[0])]

prefix = IN[2]
for v in views:
	nop = NavisworksExportOptions()
	nop.ExportScope = NavisworksExportScope.View
	nop.ViewId = v.Id
	doc.Export(IN[1],prefix + v.Name,nop)

OUT = "Success"
# ----------------------------------------
OUT = Output(python_script)
