# Dynamo custom node UI.Listview Data.dyf (Dynamo 1.3.0.875)
# category: Data-Shapes.UI
# Create data for ListView input in UI.MultiInputForm ++ . Check out www.data-shapes.net for more infos.

InputName = Input(InputName : string = "Input")
Keys = Input()  # "Keys : []"
Values = Input()  # "Values : []"
Height = Input(Height : int = 200)
HighlightInView = Input(HighlightInView : bool = false)  # If true clicking elements of the listview will highlight it in a view like Dynamo's watch node
DisplayModeOnly = Input(DisplayModeOnly : bool = false)  # Turns off ability to select elements. Form will not output any data for this element.
ShowElementCount = Input(ShowElementCount : bool = false)  # Will display the number of elements underneath the input name
DefaultValueIndices = Input(DefaultValueIndices : int[] = DSCore.List.Empty)
python_script = Python(IN[0]=InputName, IN[1]=Keys, IN[2]=Values, IN[3]=Height, IN[4]=HighlightInView, IN[5]=DisplayModeOnly, IN[6]=ShowElementCount, IN[7]=DefaultValueIndices)
# ---------- python_script.python (55 lines) ----------
#Copyright (c) mostafa el ayoubi ,  2016
#Data-Shapes www.data-shapes.net , elayoubi.mostafa@gmail.com

class listview():

    def __init__(self,inputname,height,highlight,display_mode,element_count,default_values):
        self.inputname = inputname
        self.height = height
        self.highlight = highlight
        self.display_mode = display_mode
        self.element_count = element_count
        self.default_values = default_values

    def __setitem__(self, key, item):
        self.__dict__[key] = item

    def __getitem__(self, key):
        return self.__dict__[key]

    def __iter__(self):
        return iter(self.__dict__)

    def values(self):
        return self.__dict__.values()

    def keys(self):
        return self.__dict__.keys()

    def __repr__(self):
        return 'UI.ListView input'

if isinstance(IN[1],list):
	in1 = IN[1]
else:
	in1 = [IN[1]]

if isinstance(IN[2],list):
	in2 = IN[2]
else:
	in2 = [IN[2]]

if IN[6]:
	element_count = len(in1)
else:
	element_count = 0

x = listview(IN[0],IN[3],IN[4],IN[5],element_count,IN[7])

for k,v in zip(in1,in2):
	try:
		x[str(k)] = v
	except:
		x[k.encode('utf-8').decode('utf-8')] = v

OUT = x
# ----------------------------------------
ListView_input = Output(python_script)
