# Dynamo custom node UI.TextBox Data.dyf (Dynamo 1.2.1.3083)
# category: Data-Shapes.UI
# Create Data for TextBox input in UI.MultipleInputForm ++ . Check out www.data-shapes.net for more informations

InputName = Input(InputName : string = "Input")
DefaultText = Input(DefaultText: string = "Default")
python_script = Python(IN[0]=InputName, IN[1]=DefaultText)
# ---------- python_script.python (16 lines) ----------
#Copyright (c) mostafa el ayoubi ,  2016
#Data-Shapes www.data-shapes.net , elayoubi.mostafa@gmail.com

class uitext():

    def __init__(self,inputname,defaultvalue):
        self.inputname = inputname
        self.defaultvalue = defaultvalue

    def __repr__(self):
        return 'UI.Textbox input'
        
x = uitext(IN[0],IN[1])


OUT = x
# ----------------------------------------
TextBox_input = Output(python_script)
